# Grasshopper definition main.gh (Grasshopper 1.0.8)
# plug-ins: RhinoCodePluginGH

bake = BooleanToggle(True)
pipeline = GeometryPipeline(
    GroupByLayer=False,
    GroupByType=False,
    IncludeHidden=True,
    IncludeLocked=True,
    LayerFilter="3D_new::Buildings::Mixed Use RC",
    NameFilter="*",
    SublayerFiltering=True,
    TypeFilter=1073741848)
pipeline_2 = GeometryPipeline(
    GroupByLayer=False,
    GroupByType=False,
    IncludeHidden=True,
    IncludeLocked=True,
    LayerFilter="3D_new::Buildings::Culture",
    NameFilter="*",
    SublayerFiltering=True,
    TypeFilter=1073741848)  # disabled
pipeline_3 = GeometryPipeline(
    GroupByLayer=False,
    GroupByType=False,
    IncludeHidden=True,
    IncludeLocked=True,
    LayerFilter="3D_new::Buildings::School",
    NameFilter="*",
    SublayerFiltering=True,
    TypeFilter=1073741848)
pipeline_4 = GeometryPipeline(
    GroupByLayer=False,
    GroupByType=False,
    IncludeHidden=True,
    IncludeLocked=True,
    LayerFilter="3D_new::Buildings::Sports",
    NameFilter="*",
    SublayerFiltering=True,
    TypeFilter=1073741848)
pipeline_5 = GeometryPipeline(
    GroupByLayer=False,
    GroupByType=False,
    IncludeHidden=True,
    IncludeLocked=True,
    LayerFilter="3D_new::Buildings::Admin",
    NameFilter="*",
    SublayerFiltering=True,
    TypeFilter=1073741848)
pipeline_6 = GeometryPipeline(
    GroupByLayer=False,
    GroupByType=False,
    IncludeHidden=True,
    IncludeLocked=True,
    LayerFilter="3D_new::Buildings::Commercial",
    NameFilter="*",
    SublayerFiltering=True,
    TypeFilter=1073741848)
pipeline_7 = GeometryPipeline(
    GroupByLayer=False,
    GroupByType=False,
    IncludeHidden=True,
    IncludeLocked=True,
    LayerFilter="3D_new::Buildings::Office",
    NameFilter="*",
    SublayerFiltering=True,
    TypeFilter=1073741848)
pipeline_8 = GeometryPipeline(
    GroupByLayer=False,
    GroupByType=False,
    IncludeHidden=True,
    IncludeLocked=True,
    LayerFilter="3D_new::Buildings::Tourism",
    NameFilter="*",
    SublayerFiltering=True,
    TypeFilter=1073741848)
pipeline_9 = GeometryPipeline(
    GroupByLayer=False,
    GroupByType=False,
    IncludeHidden=True,
    IncludeLocked=True,
    LayerFilter="3D_new::Buildings::Utility",
    NameFilter="*",
    SublayerFiltering=True,
    TypeFilter=1073741848)  # disabled
pipeline_10 = GeometryPipeline(
    GroupByLayer=False,
    GroupByType=False,
    IncludeHidden=True,
    IncludeLocked=True,
    LayerFilter="3D_new::Buildings::Bridging Mass",
    NameFilter="*",
    SublayerFiltering=True,
    TypeFilter=1073741848)
pipeline_11 = GeometryPipeline(
    GroupByLayer=False,
    GroupByType=False,
    IncludeHidden=True,
    IncludeLocked=True,
    LayerFilter="3D_new::Buildings::Residential",
    NameFilter="*",
    SublayerFiltering=True,
    TypeFilter=1073741848)
number_slider = Slider(6, range=0..10)  # disabled
number_slider_2 = Slider(6, range=0..10)  # disabled
number_slider_3 = Slider(3, range=0.1..10)  # disabled
number_slider_4 = Slider(0.5, range=0..1)  # disabled
number_slider_5 = Slider(6, range=0..10)
number_slider_6 = Slider(0.5, range=0..1)
number_slider_7 = Slider(6, range=0..10)
number_slider_8 = Slider(5, range=0.1..10)
builder = Python3Script(
    script=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,
    breps=pipeline_11,
    glass_dist=Slider(2, range=0..10),
    frame_dist=Slider(0.2, range=0..1),
    core_dist=Slider(6, range=0..10),
    slab_thick=Slider(0.5, range=0..1),
    bake=bake)  # -> out, glasses, glass_frames, cores, slabs; inputs breps: list of Brep, bake: Boolean; disabled
#   port script: Script to execute
# ---------- builder: Python ----------
import ghpythonlib.components as ghcomp
import Rhino.Geometry as geo
import scriptcontext as sc
import random


def trim_crv_from_length(crv, length, reverse=False):
    # type: (geo.Curve, float, bool) -> geo.Curve
    """crv의 시작점부터 lenth까지의 커브를 구한다."""
    is_len_possible, param = crv.LengthParameter(length)
    if not is_len_possible:
        return crv

    ## for Rhino 8, REMOVE FOR RHINO7 !!!##
    param = float(param)
    ########################################

    if reverse:
        return crv.Trim(param, crv.Domain.Max)

    return crv.Trim(0.0, param)


class Floor:
    def __init__(self, brep):
        self.height = 0.0
        self.brep = brep
        self.faces = None
        self.floor = None
        self.ceiling = None
        self.glass = None
        self.glass_frames = None
        self.core = None
        self.slab = None
        self._initialize()

    def _initialize(self):
        self.breps = ghcomp.DeconstructBrep(self.brep)[0]
        self.faces = [brep.Faces[0] for brep in self.breps]
        self.floor = min(self.faces, key=lambda face: face.PointAt(0.5, 0.5).Z)
        self.ceiling = max(self.faces, key=lambda face: face.PointAt(0.5, 0.5).Z)
        self.glass = [
            face for face in self.faces if face != self.floor and face != self.ceiling
        ]
        self.height = self.ceiling.PointAt(0.5, 0.5).Z - self.floor.PointAt(0.5, 0.5).Z

    def set_glass_frames(self, distance, frame_distance):
        if self.glass is None:
            return
        glass_frames = []
        edges = self.floor.Brep.DuplicateEdgeCurves()
        for edge in edges:
            params = edge.DivideByLength(distance, True)
            if not params:
                continue
            for i in range(len(params) - 1):
                segment = edge.Trim(params[i], params[i + 1])

                if segment:
                    frame_curve = segment.DuplicateCurve()
                    frame_curve = trim_crv_from_length(frame_curve, frame_distance)

                    if not frame_curve:
                        continue
                        raise ValueError("frame_curve is None")
                    frame_surface = geo.Extrusion.Create(
                        frame_curve, self.height, False
                    )
                    glass_frames.append(frame_surface)

        self.glass_frames = glass_frames

    def set_core(self, offset_distance):
        if self.floor is None:
            return
        floor_edges = self.floor.Brep.DuplicateEdgeCurves()
        floor_edge = ghcomp.JoinCurves(floor_edges, True)
        core_edge = ghcomp.OffsetCurve(floor_edge, -offset_distance, corners=1)

        if isinstance(core_edge, geo.Curve):
            self.core = geo.Extrusion.Create(core_edge, -self.height, True)

    def set_slab(self, thickness):
        if self.floor is None:
            return
        ceiling_edges = self.ceiling.Brep.DuplicateEdgeCurves()
        ceiling_edge = ghcomp.JoinCurves(ceiling_edges, True)
        self.slab = geo.Extrusion.Create(ceiling_edge, -thickness, True)


### input = breps, glass_dist, frame_dist, core_dist, slab_thick


def cluster_breps(breps, threshold=0.1):
    clusters = []
    for brep in breps:
        added = False
        for cluster in clusters:
            if any(
                brep.ClosestPoint(
                    other_brep.ClosestPoint(
                        brep.ClosestPoint(geo.Point3d(0.5, 0.5, 0.5))
                    )
                ).DistanceTo(
                    other_brep.ClosestPoint(
                        brep.ClosestPoint(geo.Point3d(0.5, 0.5, 0.5))
                    )
                )
                <= threshold
                for other_brep in cluster
            ):
                cluster.append(brep)
                added = True
                break
        if not added:
            clusters.append([brep])
    return clusters


clusters = cluster_breps(breps)

glasses = []
glass_frames = []
cores = []
slabs = []

for cluster in clusters:
    _glass_dist = glass_dist * random.uniform(0.8, 2.4)
    _frame_dist = frame_dist * random.uniform(0.8, 1.8)
    _core_dist = core_dist * random.uniform(0.8, 1.2)
    _slab_thick = slab_thick * random.uniform(0.8, 1.2)

    for brep in cluster:
        try:
            floor = Floor(brep)
            floor.set_glass_frames(_glass_dist, _frame_dist)
            floor.set_core(_core_dist)
            floor.set_slab(_slab_thick)

            glasses.extend(floor.glass)
            glass_frames.extend(floor.glass_frames)
            cores.append(floor.core)
            slabs.append(floor.slab)
        except Exception as e:
            print(f"Error processing brep: {e}")
            continue
# ---------- end builder ----------
builder_2 = Python3Script(
    script=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,
    breps=pipeline_4,
    glass_dist=Slider(6, range=0..10),
    frame_dist=Slider(3, range=0.1..10),
    core_dist=Slider(6, range=0..10),
    slab_thick=Slider(0.5, range=0..1),
    bake=bake)  # -> out, glasses, glass_frames, cores, slabs; inputs breps: list of Brep, bake: Boolean; disabled; same code as builder
builder_3 = Python3Script(
    script=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,
    breps=pipeline_6,
    glass_dist=Slider(6, range=0..10),
    frame_dist=Slider(3, range=0.1..10),
    core_dist=Slider(6, range=0..10),
    slab_thick=Slider(0.5, range=0..1),
    bake=bake)  # -> out, glasses, glass_frames, cores, slabs; inputs breps: list of Brep, bake: Boolean; same code as builder
builder_4 = Python3Script(
    script=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,
    breps=pipeline_3,
    glass_dist=Slider(5, range=0..10),
    frame_dist=Slider(3, range=0.1..10),
    core_dist=Slider(6, range=0..10),
    slab_thick=Slider(0.5, range=0..1),
    bake=bake)  # -> out, glasses, glass_frames, cores, slabs; inputs breps: list of Brep, bake: Boolean; disabled; same code as builder
builder_5 = Python3Script(
    script=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,
    breps=pipeline,
    glass_dist=Slider(6, range=0..10),
    frame_dist=Slider(0.2, range=0..1),
    core_dist=Slider(6, range=0..10),
    slab_thick=Slider(0.5, range=0..1),
    bake=bake)  # -> out, glasses, glass_frames, cores, slabs; inputs breps: list of Brep, bake: Boolean; disabled; same code as builder
py3 = Python3Script()  # -> out, a; disabled; unedited script template
pipeline_12 = GeometryPipeline(
    GroupByLayer=False,
    GroupByType=False,
    IncludeHidden=True,
    IncludeLocked=True,
    LayerFilter="3D_new::Buildings::test",
    NameFilter="*",
    SublayerFiltering=True,
    TypeFilter=1073741848)  # disabled
geo = Geometry(builder.slabs)
geo_2 = Geometry(builder.glasses)
geo_3 = Geometry(builder.glass_frames)
geo_4 = Geometry(builder.cores)
geo_5 = Geometry(builder_2.glasses)
geo_6 = Geometry(builder_2.glass_frames)
geo_7 = Geometry(builder_2.cores)
geo_8 = Geometry(builder_2.slabs)
geo_9 = Geometry(builder_3.glasses)
geo_10 = Geometry(builder_3.glass_frames)
geo_11 = Geometry(builder_3.slabs)
geo_12 = Geometry(builder_3.cores)
geo_13 = Geometry(builder_4.glass_frames)
geo_14 = Geometry(builder_4.slabs)
geo_15 = Geometry(builder_4.glasses)
geo_16 = Geometry(builder_4.cores)
geo_17 = Geometry(builder_5.glasses)
geo_18 = Geometry(builder_5.glass_frames)
geo_19 = Geometry(builder_5.cores)
geo_20 = Geometry(builder_5.slabs)
panel = Panel(builder_5.out)
panel_2 = Panel(builder_3.out)
number_slider_9 = Slider(6, range=0..10)  # disabled
number_slider_10 = Slider(3, range=0.1..10)  # disabled
number_slider_11 = Slider(6, range=0..10)  # disabled
number_slider_12 = Slider(0.5, range=0..1)  # disabled
button = Button()  # disabled
builder_6 = Python3Script(
    script=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,
    breps=pipeline_12,
    glass_dist=number_slider_9,
    frame_dist=number_slider_10,
    core_dist=number_slider_11,
    slab_thick=number_slider_12,
    bake=button)  # -> out, glasses, glass_frames, cores, slabs; inputs breps: list of Brep, bake: Boolean; disabled; same code as builder
py3_2 = Python3Script(y=Slider(39, range=0..100))  # -> a, b, c, d, e; inputs y: Int32
# ---------- py3_2: Python ----------
import scriptcontext as sc
import ghpythonlib.components as ghcomp
import Rhino.Geometry as geo

a = sc.sticky["clusters"][y]
# ---------- end py3_2 ----------
geo_21 = Geometry(py3_2.e)
geo_22 = Geometry(py3_2.c)
geo_23 = Geometry(py3_2.d)
geo_24 = Geometry(py3_2.b)
geo_25 = Geometry(py3_2.a)
geo_26 = Geometry(<brep referenced from the Rhino model>)
geo_27 = Geometry(<brep referenced from the Rhino model>)
geo_28 = Geometry(builder_6.glasses)  # disabled
geo_29 = Geometry(builder_6.glass_frames)  # disabled
geo_30 = Geometry(builder_6.slabs)  # disabled
geo_31 = Geometry(builder_6.cores)  # disabled
py3_3 = Python3Script(x=geo_26, y=geo_27)  # -> out, a; inputs x: Brep, y: Brep
# ---------- py3_3: Python ----------
import Rhino.Geometry as geo

def are_breps_touching(brep1, brep2, threshold):
    for vertex in brep1.Vertices:
        point = vertex.Location
        closest_point = brep2.ClosestPoint(point)
        distance = point.DistanceTo(closest_point)
        if distance < threshold:
            return True
    return False

print (are_breps_touching(x,y, 1))
# ---------- end py3_3 ----------
sph = Sphere(Base=py3_2.d, Radius=1)
panel_3 = Panel(builder_6.out)
panel_4 = Panel(py3_3.out)
